% Simulink data dictionary motor_ctrl_data.sldd

motor_ctrl_config = Simulink.ConfigSet(StartTime="0", StopTime="10", FixedStep="0.1", Solver="FixedStepAuto", ProdHWDeviceType="ARM Compatible->ARM Cortex-M", SystemTargetFile="ert.tlc", TargetLang="C")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

modbus_regs = Simulink.Bus(DataScope="Imported", HeaderFile="mb_config.h")
  discs: uint8[256]
  coils: uint8[256]
  inputs: int16[256]
  holdings: int16[256]

sys_regs = Simulink.Signal(StorageClass="ImportFromFile", HeaderFile="fnd_com.h", DataType="Bus: modbus_regs")
ee_ram = Simulink.Signal(StorageClass="ImportFromFile", HeaderFile="ee.h", DataType="uint8", Dimensions=128)
relay = Simulink.Signal(StorageClass="ImportFromFile", HeaderFile="fnd_com.h", DataType="int16", Dimensions=8)
rmt_cmd = Simulink.Signal(StorageClass="ImportFromFile", HeaderFile="fnd_com.h", DataType="uint64", Dimensions=20)
rmt_index = Simulink.Signal(StorageClass="ImportFromFile", HeaderFile="fnd_com.h", DataType="uint8")